# Grasshopper definition trace_rays_test.ghx (Grasshopper 1.0.8)

reload = Python3Script(reload=Button())  # inputs reload: Boolean
# ---------- reload: Python ----------
# venv: rhino_compas_acoustics
# r: compas
# r: pyroomacoustics
# r: matplotlib
# r: librosa
# r: soundfile
# r: sounddevice
# r: sofar
# r: pyfar
# r: pyrato

import sys
import os
from compas_rhino import unload_modules


gh_path = ghenv.Component.OnPingDocument().FilePath
dire_path = os.path.dirname(os.path.dirname(gh_path))
target_path = os.path.join(dire_path, "src")

if target_path not in sys.path:
    sys.path.insert(0, target_path)

if reload:
    unload_modules('compas_acoustics')

try:
    import compas_acoustics as ca
except Exception as e:
    raise ValueError(e)
# ---------- end reload ----------

pt = Point(Point(30.88932666, 12.68585919, 1.665652195))
pt_2 = Point(Point(52.69586196, 15.12393603, 11.31211074))
brickwall = Compas_acousticsMaterialLibrary()  # -> material
#   port material: AcousticMaterial object.
# ---------- brickwall: Python ----------
"""Preset picker for AcousticMaterial. Right-click to choose a material from the materials_library folder."""
# flake8: noqa
import Grasshopper
from System.Windows.Forms import ToolStripSeparator
from compas_acoustics.materials_library import MaterialsLibrary


class MaterialLibraryPicker(Grasshopper.Kernel.GH_ScriptInstance):

    def __init__(self):
        super().__init__()
        self.library = MaterialsLibrary()
        nickname = ghenv.Component.NickName
        self.material_name = nickname if nickname in self.library.material_names else None

    def RunScript(self):
        names = sorted(self.library.material_names)
        if not names:
            ghenv.Component.AddRuntimeMessage(
                Grasshopper.Kernel.GH_RuntimeMessageLevel.Error, "No material presets found in the materials library."
            )
            return None

        if self.material_name not in names:
            ghenv.Component.AddRuntimeMessage(
                Grasshopper.Kernel.GH_RuntimeMessageLevel.Remark, "Right-click the icon to choose a material."
            )
            ghenv.Component.Message = None
            return None

        ghenv.Component.Message = self.material_name
        return self.library.material_from_name(self.material_name)

    def AppendAdditionalMenuItems(self, menu):
        for name in sorted(self.library.material_names):
            item = menu.Items.Add(name, None, self.on_item_click)
            item.Checked = (name == self.material_name)

        menu.Items.Add(ToolStripSeparator())

    def on_item_click(self, sender, event_info):
        name = str(sender)
        if name == self.material_name:
            return
        self.material_name = name
        ghenv.Component.NickName = name
        ghenv.Component.ExpireSolution(True)
# ---------- end brickwall ----------
box = Box({Plane=PlaneXY(20.00053458, 0.5669237512, 0), X=Domain(0, 45.58007894), Y=Domain(0, 23.01213446), Z=Domain(0, 47.02530001)})
yz = YZPlane(Origin=Point(0, 0, 0))
ln = Line(StartPoint=pt, EndPoint=pt_2)
pt_3 = Point(Point(41.06241037, 7.089140158, 31.31499817))
smesh = SimpleMesh(Brep=box)
xy = XYPlane(Origin=Point(0, 0, 0))
Z = UnitZ(Factor=Slider(4, range=0..10))
X = UnitX(Factor=Slider(6.1, range=0..10))
xz = XZPlane(Origin=Point(0, 0, 0))
Y = UnitY(Factor=Slider(5, range=0..10))
source = Compas_acousticsSource(position=pt, direction=ln)  # -> source; inputs position: Point3d, direction: Vector3d, directivity: String, name: String, sound_file: String
#   port position: Position of the source.
#   port direction: Direction of the source.
#   port directivity: Directivity of the source. Default is Omnidirectional. Options: - Bidirectional - Hypercardioid - Supercardioid - Cardioid - Omnidirectional
#   port name: Name of the source.
#   port sound_file: Sound file associated with the source.
#   port source: Source object.
# ---------- source: Python ----------
"""Acoustic Source object (speaker, human, etc.)."""
# flake8: noqa
import Grasshopper
import Rhino
from compas_acoustics import Source


class CreateSource(Grasshopper.Kernel.GH_ScriptInstance):
    ITEMS = ["bidirectional", "hypercardioid", "supercardioid", "cardioid", "omnidirectional"]

    def RunScript(self,
            position: Rhino.Geometry.Point3d,
            direction: Rhino.Geometry.Vector3d,
            directivity: str,
            name: str,
            sound_file: str):
        if position is None:
            position = Rhino.Geometry.Point3d(0, 0, 0)
        if direction is None:
            direction = Rhino.Geometry.Vector3d(1, 0, 0)

        if directivity is None:
            dirt = "omnidirectional"
        elif directivity not in self.ITEMS:
            ghenv.Component.AddRuntimeMessage(
                Grasshopper.Kernel.GH_RuntimeMessageLevel.Error, "Input parameter 'directivity' is not valid."
            )
            return None
        else:
            dirt = directivity

        if name is None:
            name = "my_source"

        return Source(
            name,
            *position,
            directivity=dirt,
            direction=[*direction],
            sound_file=sound_file
        )
# ---------- end source ----------
receiver = Compas_acousticsReceiver(position=pt_3)  # -> receiver; inputs position: Point3d, name: String
#   port position: Position of the receiver.
#   port name: Name of the receiver.
#   port receiver: Receiver object.
# ---------- receiver: Python ----------
"""Acoustic Receiver object (microphone, human ear, etc.)."""
# flake8: noqa
import Grasshopper
import Rhino
from compas_acoustics import Receiver

# TODO: Implement direction
class CreateReceiver(Grasshopper.Kernel.GH_ScriptInstance):

    def RunScript(self, position: Rhino.Geometry.Point3d, name: str):
        if position is None:
            position = Rhino.Geometry.Point3d(0, 0, 1)
        if name is None:
            name = "my_receiver"

        return Receiver(name, *position)
# ---------- end receiver ----------
move = Move(Geometry=xy, Motion=Z)  # -> Geometry, Transform
move_2 = Move(Geometry=yz, Motion=X)  # -> Geometry, Transform
move_3 = Move(Geometry=xz, Motion=Y)  # -> Geometry, Transform
obj = Compas_acousticsAcousticObject(geometry=smesh, material=brickwall)  # -> acoustic_object; inputs geometry: GeometryBase, name: String
#   port geometry: Geometry of the AcousticObject.
#   port material: Material of the AcousticObject.
#   port name: Name of the AcousticObject.
#   port acoustic_object: AcousticObject object.
# ---------- obj: Python ----------
"""Create an AcousticObject with the specified geometry and material."""
# flake8: noqa
import Grasshopper
import Rhino
from compas_acoustics.geometry import AcousticObject
from compas_rhino.conversions import mesh_to_compas
from compas_rhino.conversions import polyline_to_compas

# TODO: Change the typeHintID in metadata.json from "mesh" to "geometrybase"

class CreateAcousticObject(Grasshopper.Kernel.GH_ScriptInstance):

    def RunScript(self, geometry: Rhino.Geometry.GeometryBase, material, name: str):

        if geometry is None:
            ghenv.Component.AddRuntimeMessage(
                Grasshopper.Kernel.GH_RuntimeMessageLevel.Warning, "No geometry provided."
            )
            return
        if material is None:
            ghenv.Component.AddRuntimeMessage(
                Grasshopper.Kernel.GH_RuntimeMessageLevel.Warning, "No material provided."
            )
            return

        # Gemetry conversion from Rhino to Compas
        # TODO: Figure out how to handle other geometry types (e.g., Brep, Surface, etc.)
        if isinstance(geometry, Rhino.Geometry.Mesh):
            geometry = mesh_to_compas(geometry)
        elif isinstance(geometry, Rhino.Geometry.Polyline):
            geometry = polyline_to_compas(geometry)
        elif isinstance(geometry, Rhino.Geometry.PolylineCurve):
            geometry = polyline_to_compas(geometry.ToPolyline())
        else:
            ghenv.Component.AddRuntimeMessage(
                Grasshopper.Kernel.GH_RuntimeMessageLevel.Error, "Unsupported geometry type."
            )
            return
        return AcousticObject(acoustic_geometry=geometry, material=material, name=name)
# ---------- end obj ----------
neg = Negative(Value=Slider(22, range=0..45))
deplane = DeconstructPlane(Plane=move.Geometry)  # -> Origin, XAxis, YAxis, ZAxis
neg_2 = Negative(Value=Slider(10, range=0..45))
deplane_2 = DeconstructPlane(Plane=move_2.Geometry)  # -> Origin, XAxis, YAxis, ZAxis
rot3d = Rotate3D(Geometry=move.Geometry, Angle=degrees(neg), Center=deplane.Origin, Axis=deplane.XAxis)  # -> Geometry, Transform
rot3d_2 = Rotate3D(Geometry=move_2.Geometry, Angle=degrees(neg_2), Center=deplane_2.Origin, Axis=deplane_2.XAxis)  # -> Geometry, Transform
deplane_3 = DeconstructPlane(Plane=rot3d_2.Geometry)  # -> Origin, XAxis, YAxis, ZAxis
scene = Compas_acousticsRoomScene(objects=flatten(obj), sources=flatten(source), receivers=flatten(receiver))  # -> scene; inputs objects: list, sources: list, receivers: list, name: String
#   port objects: List of AcousticObject
#   port sources: List of Source objects.
#   port receivers: List of Receiver objects.
#   port name: Name of the room scene.
#   port scene: Room scene object.
# ---------- scene: Python ----------
"""Create a room scene with the specified objects, sources, and receivers."""
# flake8: noqa
import Grasshopper

import System
from compas_acoustics.scene import Scene
from compas_acoustics.source import Source
from compas_acoustics.receiver import Receiver


class CreateModelScene(Grasshopper.Kernel.GH_ScriptInstance):

    def RunScript(self,
            objects: System.Collections.Generic.List[object],
            sources: System.Collections.Generic.List[object],
            receivers: System.Collections.Generic.List[object],
            name: str):

        if objects is None:
            ghenv.Component.AddRuntimeMessage(
                Grasshopper.Kernel.GH_RuntimeMessageLevel.Warning, "No objects provided."
            )
            return
        if sources is None:
            ghenv.Component.AddRuntimeMessage(
                Grasshopper.Kernel.GH_RuntimeMessageLevel.Warning, "No sources provided."
            )
            return
        if receivers is None:
            ghenv.Component.AddRuntimeMessage(
                Grasshopper.Kernel.GH_RuntimeMessageLevel.Warning, "No receivers provided."
            )
            return

        scene = Scene(name=name)
        scene.add_acoustic_objects(objects)
        for src in sources:
            if isinstance(src, Source):
                scene.add_source(src)
            else:
                ghenv.Component.AddRuntimeMessage(
                    Grasshopper.Kernel.GH_RuntimeMessageLevel.Error,
                    f"Invalid source type: {type(src)}. Expected a Source object.",
                )
        for rcv in receivers:
            if isinstance(rcv, Receiver):
                scene.add_receiver(rcv)
            else:
                ghenv.Component.AddRuntimeMessage(
                    Grasshopper.Kernel.GH_RuntimeMessageLevel.Error,
                    f"Invalid receiver type: {type(rcv)}. Expected a Receiver object.",
                )

        return scene
# ---------- end scene ----------
rot3d_3 = Rotate3D(Geometry=rot3d_2.Geometry, Angle=degrees(Slider(22, range=0..45)), Center=deplane_3.Origin, Axis=deplane_3.YAxis)  # -> Geometry, Transform
_3px = PlanePlanePlane(PlaneA=rot3d.Geometry, PlaneB=rot3d_3.Geometry, PlaneC=move_3.Geometry)  # -> Point, LineAB, LineAC, LineBC
py3 = Python3Script(scene=scene, ref_db=Slider(91, range=0..100))  # -> out, spl, pts_tree, spls_tree
# ---------- py3: Python ----------
import math
import numpy as np
import pyroomacoustics as pra
import compas_acoustics as ca

def spl_at_distance(start_db, distance):
    """
    Calculate sound pressure level (Lp) in dB after geometric spreading over distance (meters).
    Only support omni directivity now.
    """

    if distance <= 0:
        return (start_db)

    sphere_area = 4.0 * math.pi * (distance ** 2)

    return start_db - 10.0 * math.log10(sphere_area)
    
def trace_rays(room, sources, receivers, start_db, n_rays, max_order):
    engine = room.room_engine
    walls = room.walls
    max_dist = float(engine.max_dist)

    # 1. Correct Decibel Partitioning for N rays: Lw_ray = Lw_total - 10*log10(N)
    init_ray_lw = start_db - 10.0 * math.log10(float(n_rays))

    # Fibonacci sphere sampling for uniform 3D direction vectors
    directions = np.asarray(pra.fibonacci_spherical_sampling(n_rays)).T

    hits_of_sources = []
    for src in sources:
        pos_init = np.asarray(src.position, dtype=float)

        hits_of_n_rays = []
        for dire_init in directions:
            pos = pos_init.copy()
            dire = dire_init / np.linalg.norm(dire_init)

            ray_lw = init_ray_lw
            dist_travelled = 0.0
            hits = []

            for _ in range(max_order):
                hit, wall_idx, hit_dist = engine.next_wall_hit(
                    pos, pos + dire * max_dist, False
                )
                if wall_idx == -1:
                    break

                hit = np.asarray(hit, dtype=float)
                dist_travelled += float(hit_dist)

                # 2. Cumulative Geometric Spreading (SPL at current unfolded distance)
                # Lp = Lw_ray - 10*log10(4 * pi * d_total^2)
                sphere_area = 4.0 * math.pi * (dist_travelled**2)
                current_spl = ray_lw - 10.0 * math.log10(sphere_area)

                # Stop tracing if ray energy drops below hearing/noise threshold
                if current_spl <= 0.0:
                    break

                # Store hit record: position, arrival distance, and current SPL (dB)
                hits.append(
                    {"point": hit, "distance": dist_travelled, "spl": current_spl}
                )

                # 3. Wall Absorption Loss in Decibels: + 10*log10(1 - alpha)
                wall = walls[wall_idx]
                absorption = float(
                    np.mean(np.asarray(wall.absorption, dtype=float))
                )
                remaining_factor = max(1.0 - absorption, 1e-6)
                ray_lw += 10.0 * math.log10(remaining_factor)

                # Specular reflection update
                dire = np.asarray(wall.normal_reflect(dire), dtype=float)
                pos = hit

            hits_of_n_rays.append(hits)
        hits_of_sources.append(hits_of_n_rays)

    return hits_of_sources


# Example execution:
room = ca.pra_converter.scene_to_pra_room(
    scene, 16000, max_order=1, ray_tracing=False, air_absorption=False
)
source = scene.sources
receiver = scene.receivers
ref_db = 91.0

ray_hits = trace_rays(room, source, receiver, ref_db, n_rays=2, max_order=100)


import Rhino.Geometry as rg
from Grasshopper import DataTree
from Grasshopper.Kernel.Data import GH_Path
def hits_to_datatree(hits_of_sources):
    """Converts nested hit dictionaries into a Grasshopper DataTree of Point3d.

    DataTree Branch Paths: {source_index; ray_index}
    """
    pt_tree = DataTree[rg.Point3d]()
    spl_tree = DataTree[float]()  # Optional: also tracks dB values per hit

    for src_idx, src_rays in enumerate(hits_of_sources):
        for ray_idx, ray_hits in enumerate(src_rays):
            path = GH_Path(src_idx, ray_idx)

            for hit in ray_hits:
                # hit is a dict: {"point": array, "distance": float, "spl": float}
                pt = rg.Point3d(hit["point"][0], hit["point"][1], hit["point"][2])
                pt_tree.Add(pt, path)
                spl_tree.Add(float(hit["spl"]), path)

    return pt_tree, spl_tree


# Grasshopper outputs:
pts_tree, spls_tree = hits_to_datatree(ray_hits)
# ---------- end py3 ----------
mirror = Mirror(Geometry=rot3d_3.Geometry, Plane=PlaneYZ(0, 0, 0))  # -> Geometry, Transform
_3px_2 = PlanePlanePlane(PlaneA=rot3d.Geometry, PlaneB=mirror.Geometry, PlaneC=move_3.Geometry)  # -> Point, LineAB, LineAC, LineBC
ppx = PlanePlane(PlaneA=rot3d.Geometry, PlaneB=rot3d_3.Geometry)
ppx_2 = PlanePlane(PlaneA=rot3d.Geometry, PlaneB=mirror.Geometry)
ppx_3 = PlanePlane(PlaneA=rot3d.Geometry, PlaneB=move_3.Geometry)
ppx_4 = PlanePlane(PlaneA=rot3d_3.Geometry, PlaneB=move_3.Geometry)
ppx_5 = PlanePlane(PlaneA=mirror.Geometry, PlaneB=move_3.Geometry)
panel = Panel(py3.spl)
number_slider = Slider(6, range=0..100)
crv = Curve([ppx, ppx_2, ppx_3, ppx_4, ppx_5])
pline = PolyLine(Vertices=py3.pts_tree, Closed=False)
panel_2 = Panel(py3.spls_tree)
ext = ExtendCurve(Curve=crv, Type=0, Start=number_slider, End=number_slider)
